# Grasshopper definition parallel_computing.gh (Grasshopper 1.0.7)
# Copyright: AMDlab

# 並列で処理をしてみる
# ・Parallel.Forで実装
# ・Parallel.ForEachで実装
# 例）線分を分割する
number_slider = Slider(100, range=0..200)
# 無作為な線分を用意
number_slider_2 = Slider(300, range=0..1000)
rectangle = Rectangle(Plane=PlaneXY(0, 0, 0), XSize=number_slider_2, YSize=Slider(300, range=0..1000), Radius=0)  # -> Rectangle, Length
random = Random(Range=Domain(0, 1), Number=number_slider, Seed="0")
random_2 = Random(Range=Domain(0, 1), Number=number_slider, Seed="1")
number_slider_3 = Slider(150, range=1..1000)
for = CSharpScript(a=random, b=random_2)  # -> out, A; inputs a: list of Double, b: list of Double
# ---------- for: C# usings ----------
using System.Threading.Tasks;
# ---------- for: C# ----------
    // 答えを入れる配列を作る
    var y = new double[a.Count];

    // 並列処理
    Parallel.For(0, a.Count, index => {
      y[index] = a[index] * b[index];
      });

    A = y;
# ---------- end for ----------
for_2 = CSharpScript(a=random, b=random_2)  # -> out, A; inputs a: list of Double, b: list of Double
# ---------- for_2: C# usings ----------
using System.Threading.Tasks;
using System.Linq;
# ---------- for_2: C# ----------
    // kakezanListのリストを作成
    var kakezanList = new List<Kakezan>();
    for(int i = 0; i < a.Count; i++)
      kakezanList.Add(new Kakezan(a[i], b[i]));

    // 並列処理
    Parallel.ForEach(kakezanList,
      kakezan => kakezan.Y = kakezan.Calc());

    A = kakezanList.Select(kakezan => kakezan.Y);
# ---------- for_2: C# additional code ----------
  public class Kakezan
  {
    // a_i
    public double A;
    // b_i
    public double B;
    // y_i
    public double Y;
    public Kakezan(double a, double b)
    {
      A = a;
      B = b;
    }

    // 掛け算
    public double Calc()
    {
      return A * B;
    }
  }
# ---------- end for_2 ----------
multiplication = Multiplication(A=random, B=random_2)
subtraction = Subtraction(A=multiplication, B=for.A)
subtraction_2 = Subtraction(A=multiplication, B=for_2.A)
pop2d = Populate2D(Region=rectangle.Rectangle, Count=number_slider_3, Seed=Slider(0, range=0..10))
pop2d_2 = Populate2D(Region=rectangle.Rectangle, Count=number_slider_3, Seed=Slider(1, range=0..10))
abs = Absolute(Value=subtraction)
abs_2 = Absolute(Value=subtraction_2)
ln = Line(StartPoint=pop2d, EndPoint=pop2d_2)
ma = MassAddition(Input=abs)  # -> Result, PartialResults
ma_2 = MassAddition(Input=abs_2)  # -> Result, PartialResults
無作為な線分 = Curve(ln)
# 並列処理をせず動かす
無作為な線分_2 = Curve(無作為な線分)
# Parallel.ForEachで実装
無作為な線分_3 = Curve(無作為な線分)

graft = GraftTree(Tree=無作為な線分_2, IncludeEmptyLists=True, IncludeNullItems=True)  # disabled
ccx = CurveCurve(CurveA=無作為な線分_2, CurveB=graft)  # -> Points, ParamsA, simplify(ParamsB); disabled
trim = TrimTree(Tree=ccx.ParamsB, Depth=1)  # disabled
sort = SortList(Keys=trim)  # -> Keys, ValuesA; disabled
shatter = Shatter(Curve=graft(無作為な線分_2), Parameters=sort.Keys)  # disabled
end = EndPoints(Curve=shatter)  # -> Start, End; disabled

divideline = CSharpScript(LineCurves=無作為な線分_3, tol="1e-5")  # -> out, A; inputs LineCurves: list of Curve, tol: Double
# ---------- divideline: C# usings ----------
using System.Threading.Tasks;
using System.Linq;
using Rhino.Geometry.Intersect;
# ---------- divideline: C# ----------
    // しきい値の入力
    SplitIntersect.TOL = tol;
    // SplitIntersectのリストを作成
    var splitIntersects = new List<SplitIntersect>();
    foreach(var line in LineCurves){
      splitIntersects.Add(new SplitIntersect(
        line, LineCurves.Where(item => item != line).ToList()));
    }

    // 並列処理
    Parallel.ForEach(splitIntersects,
      splitIntersect => splitIntersect.Result = splitIntersect.Calc());

    // 結果をDataTreeに入れて出力
    var resultTree = new DataTree<Curve>();
    for(int i = 0; i < splitIntersects.Count;i++)
      resultTree.AddRange(splitIntersects[i].Result, new GH_Path(i));
    A = resultTree;
# ---------- divideline: C# additional code ----------
  public class SplitIntersect
  {
    public static double TOL;
    // Aは分割される線分
    public Curve A;
    // Bsは分割する線分
    public List<Curve> Bs;
    // 分割した結果を入れる
    public Curve[] Result;
    public SplitIntersect(Curve a, List<Curve> bs)
    {
      A = a;
      Bs = bs;
    }

    // 分割する計算
    public Curve[] Calc()
    {
      var aSplit = new List<double>(){0, 1};
      // Intersection.CurveCurveである線分に対しての交点の情報を出す
      foreach(var b in Bs){
        var ci = Intersection.CurveCurve(A, b, TOL, TOL);
        foreach(var ei in ci){
          // オーバーラップ（線分が重なるとき）は除外する
          if(ei.IsOverlap) continue;
          aSplit.Add(ei.ParameterA);
        }
      }
      return A.Split(aSplit);
    }
  }
# ---------- end divideline ----------
crv = Curve(divideline.A)
end_2 = EndPoints(Curve=crv)  # -> Start, End
panel = Panel(sort.Keys)
panel_2 = Panel(ma.Result)
panel_3 = Panel(ma_2.Result)
